# Dynamo graph Pattern_Rotation.dyn (Dynamo 0.8.2.2032)

code_block = CodeBlock { 100; }
byWidthLength = Rectangle.ByWidthLength(width=code_block, length=code_block)
byPatch = Surface.ByPatch(byWidthLength)
code_block_2 = CodeBlock { 5; }
translate = Geometry.Translate(geometry=byWidthLength, zTranslation=code_block_2)
points = Polygon.Points(translate)
code_block_3 = CodeBlock { {0,30,0,0}; }
translate_2 = Geometry.Translate(geometry=points, zTranslation=code_block_3)
byPoints = Polygon.ByPoints(translate_2)
create = List.Create(byWidthLength, byPoints)
byLoft = Surface.ByLoft(create)
byPatch_2 = Surface.ByPatch(byPoints)
create_2 = List.Create(byPatch, byLoft, byPatch_2)
byJoinedSurfaces = Solid.ByJoinedSurfaces(create_2)
code_block_4 = CodeBlock { 0..#10..1; 100; }
mul = code_block_4.out0 * code_block_4.out1
translate_3 = Geometry.Translate(geometry=byJoinedSurfaces, xTranslation=mul, yTranslation=mul, lacing=CrossProduct)
flatten = Flatten(translate_3)
center = Polygon.Center(byWidthLength)
translate_4 = Geometry.Translate(geometry=center, xTranslation=mul, yTranslation=mul, lacing=CrossProduct)
byOriginNormal = Plane.ByOriginNormal(origin=translate_4)
flatten_2 = Flatten(byOriginNormal)
code_block_5 = CodeBlock(x=code_block_4.out0) { x..#10..1; }
flatten_3 = Flatten(code_block_5)

# group: Edit this number for different patterns (1-8)
code_block_6 = CodeBlock { 3; }

mod = flatten_3 % code_block_6
code_block_7 = CodeBlock { 90; }
mul_2 = mod * code_block_7
rotate = Geometry.Rotate(flatten, flatten_2, mul_2)
create_3 = List.Create()
